# Grasshopper definition test file.gh (Grasshopper 1.0.7)
# plug-ins: Dodo, SmithGroupTools, FalseStartToggle, Colibri, TT Toolbox

# GROUP TITLE
# Subtitle
core_items = Number(0)

# ----
# TITLE
# CREATED BY: NAME
# Description: Input script description here:
# SG Script Standards
# Quick Links
# Required: 1: Label big and often (60pt)
# 2: Highlight user controls and key items (red)
# 3: Number step-by-step instructions
# Recommended: 4: Group and label everything
# 5: Use pass-through containers to clarify inputs and outputs
stuck_ask_the_community = Button()
script_catalog = Button()
computation_sharepoint = Button()
x = PythonScript(x=stuck_ask_the_community)
# ---------- x: Python ----------
import webbrowser as wb
if x:
    url = 'https://teams.microsoft.com/l/channel/19%3a7b04d2f7a9db44649a89cc9ba0b42596%40thread.skype/%255E%2520Helpdesk?groupId=d6666e79-b216-41f0-9b42-1572b2b07b55&tenantId=a419c82f-5cb0-476b-a479-91ae8a7269f8'
    wb.open(url,2,True)
    print 'Happy downloading!'
else:
    print 'Set download to true...'
# ---------- end x ----------
x_2 = PythonScript(x=script_catalog)
# ---------- x_2: Python ----------
import webbrowser as wb
if x:
    url = 'http://sp.smithgroupjjr.com/disciplines/TIP/C/ScriptsViewer.aspx'
    wb.open(url,2,True)
    print 'Happy downloading!'
else:
    print 'Set download to true...'
# ---------- end x_2 ----------
# 1
x_3 = PythonScript(x=computation_sharepoint)
# ---------- x_3: Python ----------
import webbrowser as wb
if x:
    url = 'http://sp.smithgroupjjr.com/disciplines/TIP/C/default.aspx'
    wb.open(url,2,True)
    print 'Happy downloading!'
else:
    print 'Set download to true...'
# ---------- end x_3 ----------
openlogger = OpenLogger(Log=True)  # -> Success, Testing

important_items = Number(0)
suptrainnn = SupervisedTrainingNN()
param_1 = Panel("""shoo
2
3""")
param_2 = Panel("""foo
bazz
3""")
runnn = RunNeuralNetwork(NeuralNetwork=suptrainnn)  # -> Data, Weights, Threshold
iterator = ColibriIterator(param_2=param_2, param_1=param_1, RemoteFly=True, ignoreAllWarningMsg=False)  # -> param_2, param_1, Value_N, Genome, RemoteCtrl
rectangle = Rectangle(Plane=PlaneXY(0, 0, 0), XSize=Domain(-1, 1), YSize=iterator.param_2, Radius=0)  # -> Rectangle, Length
area = Area(Geometry=rectangle.Rectangle)  # -> Area, Centroid
area_2 = Number(area.Area)
path = FilePath("C:\Users\lcurtis\Documents\GitHub\daylighting-design-space\2019-0925 Daylighting Design Space.csv")
toggle = FalseStartToggle(True)
parameters = ColibriParameters(Area=flatten(area_2))
readxl = ReadExcelSheet(Run=toggle, FilePath=path, Worksheet="1", Listen=False)  # -> UserMessages, Columns, Rows
split = SplitList(List=readxl.Columns, Index="1")  # -> ListA, ListB
bang = ExplodeTree(Data=split.ListB)  # -> Branch0, Branch1, Branch2, Branch3, Branch4, Branch5
aggregator = ColibriAggregator(Folder="c:\Colibri", IterationGenomeID=iterator.Genome, IterationPhenomeResults=parameters, Write=False, recordingMode=3)
panel = Panel(bang.Branch2)
merge = Merge(Data1=bang.Branch0, Data2=bang.Branch1, Data3=bang.Branch2)
keysearch = KeyValueSearch(Keys=split.ListB)
panel_2 = Panel(split.ListA)
